# Grasshopper definition 170713_softBodyDemo.gh (Grasshopper 1.0.5)
# plug-ins: FlexHopper

mesh = Mesh(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)
vec = VectorXYZ(XComponent=15, YComponent=0, ZComponent=0)  # -> Vector, Length
xy = XYPlane(Origin=Point(0, 0, 0))
panel = Panel("""1
2
0
1.5
2
0.1
1.5
0.0
0.0""")
move = Move(Geometry=mesh, Motion=vec.Vector)  # -> Geometry, Transform
soft = SoftFromMesh(SoftBodyMesh=flatten([mesh, move.Geometry]), Velocities=Vector(0, 0, 0), Mass=1, SoftParams=panel, GroupIndex=0)  # -> Particles, SpringIndices, simplify(ShapeMatchingConstraintIndices), SpringLines, ShapeMatchingConstraintBoundingBox, SoftBodies
collgeometry = FlexCollisionGeometry(CollisionPlanes=flatten(xy))
scene = FlexScene(SoftBodies=flatten(soft.SoftBodies))
panel_2 = Panel(scene)
flex = FlexEngine(FlexCollisionGeometry=collgeometry, FlexScene=flatten(scene), LockMode=False, Reset=Button(), Go=Toggle(False))  # -> FlexObject, Information
softs = GetSoftBodies(FlexObject=flex.FlexObject, Softs=soft.SoftBodies)  # -> Points, Velocity, SpringLines, ShapeMatchingBoxes
panel_3 = Panel(flex.Information)
rigids = GetRigids(FlexObject=flex.FlexObject, N=1, Deformable=False)  # -> Points, Vector, Meshes
box = Box()
panel_4 = Panel(rigids.Points)
